# Dynamo graph 20220309_one_script_with_export_switch.dyn (Dynamo 2.10.1.3976)

# group: Site Level
site_input = CodeBlock()
# ---------- site_input.designscript (9 lines) ----------
site_x=20;
 //the overall length of the site;
site_y=20;
 //the overall widthness of the site;
site_z=4;
 //the overall height of the site;
ref_level_z=0;
 //the z-position of the reference level;
site_input = [site_x,site_y,site_z,ref_level_z];
# ----------------------------------------
all_elements_in_active_view = ElementsInView()

# group: Story Level
story_input = CodeBlock()
# ---------- story_input.designscript (4 lines) ----------
number_story=1;
 //the total amount of the stories;
story_z[]=[0];
 //corresponding z-positions of the stories;
# ----------------------------------------
default_exterior_wall_types = WallTypes("Generic - 300mm")
percentage_z_wall_position = DoubleSlider(0, range=0..70 step 1)  # graph input
default_floor_types = FloorTypes("Generic 150mm - Filled")

# group: Space Level
percentage_room_width = DoubleSlider(24, range=16..30 step 1)  # graph input
rooms_per_side_right = DoubleSlider(3, range=2..5 step 1)  # graph input
rooms_per_side_left = DoubleSlider(4, range=2..5 step 1)  # graph input
default_interior_wall_types = WallTypes("Generic - 200mm")

create_mode = BoolSelector(true)  # graph input
create_everything = Python(IN[0]=site_input.site_input, IN[1]=all_elements_in_active_view, IN[2]=story_input.number_story, IN[3]=story_input.out1, IN[4]=default_exterior_wall_types, IN[5]=percentage_z_wall_position, IN[6]=default_floor_types, IN[7]=percentage_room_width, IN[8]=rooms_per_side_right, IN[9]=rooms_per_side_left, IN[10]=default_interior_wall_types, IN[11]=create_mode)  # IronPython2
# ---------- create_everything.python (509 lines) ----------
###############################################################
# Load the Libraries
###############################################################
import clr
import sys
import math
import System

from System import Array
from System.Collections.Generic import *

clr.AddReference("RevitNodes")
import Revit

clr.ImportExtensions(Revit.Elements)
clr.ImportExtensions(Revit.GeometryConversion)

clr.AddReference("RevitServices")
import RevitServices
from RevitServices.Persistence import DocumentManager 
from RevitServices.Transactions import TransactionManager 

clr.AddReference("RevitAPI")
clr.AddReference("RevitAPIUI")

clr.AddReference('ProtoGeometry')
import Autodesk 
from Autodesk.DesignScript.Geometry import *
from Autodesk.Revit.DB import *
#from Autodesk.Revit.UI import *
from Autodesk.Revit.DB import StairsEditScope
from Autodesk.Revit.DB import Parameter
from Autodesk.Revit.DB.Architecture import StairsRun
from Autodesk.Revit.DB.Architecture import *
from Autodesk.Revit.DB import IFailuresPreprocessor

###############################################################
# Customize functions 
###############################################################
"""
Converts default unit in Dynamo into meter...
"""
def convert_meter_to_unit(pre_value):
    tempo_list = []
    tempo_value = 0
    if isinstance(pre_value, list):
        len_list = len(pre_value)
        for ii in range(len_list):
            tempo_list.append (float(UnitUtils.ConvertToInternalUnits(pre_value[ii], UnitTypeId.Meters)))
        pre_value = tempo_list
    else:
        tempo_value = float(UnitUtils.ConvertToInternalUnits(pre_value, UnitTypeId.Meters))
        pre_value = tempo_value
    return pre_value


def convert_to_meter(internal_value):
	if isinstance(internal_value, list):
		return [UnitUtils.ConvertFromInternalUnits(value, UnitTypeId.Meters) for value in internal_value]
	return float(UnitUtils.ConvertFromInternalUnits(internal_value, UnitTypeId.Meters))

"""
Provide perimeter lines from three dimensions...
"""
def find_perimeter_lines(x,y,z):
    line_list = []
    xx = x
    yy = y
    zz = z 
    # print "find_perimeter_lines x: " + str(x)
    # print "find_perimeter_lines y: " + str(y)
    # print "find_perimeter_lines z: " + str(z)
	
    line_1 = Autodesk.Revit.DB.Line.CreateBound(XYZ(0,0,zz),    XYZ(xx,0,zz))
    line_2 = Autodesk.Revit.DB.Line.CreateBound(XYZ(xx,0,zz),   XYZ(xx,yy,zz))
    line_3 = Autodesk.Revit.DB.Line.CreateBound(XYZ(xx,yy,zz),  XYZ(0,yy,zz))
    line_4 = Autodesk.Revit.DB.Line.CreateBound(XYZ(0,yy,zz),   XYZ(0,0,zz))

    line_list.append(line_1)
    line_list.append(line_2)
    line_list.append(line_3)
    line_list.append(line_4)
    
    return line_list

def z_wall_perimeter_lines(percentage_yposition, site_x, site_y, ref_level):

	line_1 = Autodesk.Revit.DB.Line.CreateBound(XYZ(site_x * 0.5, 0, ref_level), XYZ(site_x * 0.5, site_y * percentage_yposition, ref_level))
	line_2 = Autodesk.Revit.DB.Line.CreateBound(XYZ(site_x * 0.5, site_y * percentage_yposition, ref_level), XYZ(site_x * 0.4, site_y * percentage_yposition, ref_level))
	line_3 = Autodesk.Revit.DB.Line.CreateBound(XYZ(site_x * 0.4, site_y * percentage_yposition, ref_level), XYZ(site_x * 0.4, site_y, ref_level))
	# print "z_wall_perimeter_lines x: " + str(site_x * 0.5)
	# print "z_wall_perimeter_lines y: " + str(site_y * percentage_yposition)
 	# print "z_wall_perimeter_lines z: " + str(ref_level)
	
	return [line_1, line_2, line_3]
	
"""
Provide the geometry of slab by level...
"""
def slab_geometry_by_level(x,y,level,delta_z):
    zz = level.Elevation + delta_z
    xx = x
    yy = y 
    line_1 = Autodesk.Revit.DB.Line.CreateBound(XYZ(0,0,zz),    XYZ(xx,0,zz))
    line_2 = Autodesk.Revit.DB.Line.CreateBound(XYZ(xx,0,zz),   XYZ(xx,yy,zz))
    line_3 = Autodesk.Revit.DB.Line.CreateBound(XYZ(xx,yy,zz),  XYZ(0,yy,zz))
    line_4 = Autodesk.Revit.DB.Line.CreateBound(XYZ(0,yy,zz),   XYZ(0,0,zz))
    
    slab_geometry = CurveArray()
    slab_geometry.Append(line_1)
    slab_geometry.Append(line_2)
    slab_geometry.Append(line_3)
    slab_geometry.Append(line_4)
    return slab_geometry
"""
Extract the middle location of a wall to create a door
"""
def door_location_from_wall(wall, level_z, adjust):
    # adjust = 0 : in the middle of the wall
    # adjust = -1.0: at the start place of the wall (|-----x/y++++++)
    # adjust = 1.0: at the end place of the wall (-----x/y+++++|)

    door_location = Autodesk.Revit.DB.XYZ(0, 0, 0)
    adjust_x = 0
    adjust_y = 0
    wall_line = wall.Location
    wall_line_start = wall_line.Curve.GetEndPoint(0)
    wall_line_end = wall_line.Curve.GetEndPoint(1)
    if wall_line_start.X == wall_line_end.X:
        adjust_y = adjust/2 * (wall_line_end.Y - wall_line_start.Y)
    elif wall_line_start.Y == wall_line_end.Y:
        adjust_x = adjust/2 * (wall_line_end.X - wall_line_start.X)
    wall_mittex = (wall_line_start.X + wall_line_end.X)/2
    wall_mittey = (wall_line_start.Y + wall_line_end.Y)/2
    door_location = Autodesk.Revit.DB.XYZ(wall_mittex + adjust_x, wall_mittey + adjust_y, level_z)
    return door_location

###############################################################
# Current doc/app/ui
###############################################################
doc = DocumentManager.Instance.CurrentDBDocument
# uiapp = DocumentManager.Instance.CurrentUIApplication 
# app = uiapp.Application
# uidoc = uiapp.ActiveUIDocument

###############################################################
# Prepare the input
###############################################################
site_x = float(IN[0][0])                                # the overall length of the site
site_y = float(IN[0][1])                                # the overall widthness of the site
site_z = float(IN[0][2])                                # the overall height of the site
ref_level_z = float(IN[0][3])                           # the z-position of the reference level (default level = level 0, created in the prepared .rvt)
allElements = UnwrapElement(IN[1])
number_story = int (IN[2])                                          # the total amount of the stories;
story_z = IN[3]                                                     # corresponding z-positions of the stories;
default_exterior_wall_type = UnwrapElement(IN[4])                   # Default exterior wall type
percentage_z_wall_position = IN[5]
default_floor_type = UnwrapElement(IN[6])                           # Default Floor type
percentage_room_width = IN[7]
number_rooms_right_side = IN[8]									# Amount of rooms on the right side of the corridor
number_rooms_left_side = IN[9]									# Amount of rooms on the left side of the corridor
default_interior_wall_type = UnwrapElement(IN[10])				# Default interior wall type
create_mode = IN[11]

###############################################################
# Transaction in Revit
###############################################################
TransactionManager.Instance.EnsureInTransaction(doc)
###############################################################
# Define the output
###############################################################

txt_filename = None

if create_mode:
    geo_site = []                                                       # archive all the input data
    ref_level = []                                                      # the reference level
    bbox_site = []                                                      # bounding box of the site

    # Transformation into percentage
    assert 0 <= percentage_z_wall_position <= 75, 'z wall position limits violated'
    assert 10 <= percentage_room_width <= 35, 'Room width limits violated!'
    percentage_z_wall_position /= 100
    percentage_room_width /= 100

    import sys

    sys.path.append('C:\Users\ga78jem\Miniconda3\envs\trajectron++\Lib\site-packages')

    #for path in sys.path:
        #print path

    dxf_filename = 'floorplan_zPos_' + str(percentage_z_wall_position)
    dxf_filename += "_roomWidth_" + str(percentage_room_width)
    dxf_filename += "_numRleft_" + str(number_rooms_left_side)
    dxf_filename += "_numRright_" + str(number_rooms_right_side)
    txt_filename = dxf_filename + '.txt'
    dxf_filename += ".dxf"

    ###############################################################
    # Record file into a .txt
    ###############################################################
    stdout_original = sys.stdout
    stdout_file = open(txt_filename, 'w')
    sys.stdout = stdout_file

    ###############################################################
    # Convert the Units | b = UnitUtils.ConvertToInternalUnits(a, UnitTypeId.Meters)  b = a*3 | c = UnitUtils.ConvertFromInternalUnits(a, UnitTypeId.Meters)  c = a*3
    ###############################################################

    # print "site x before conversion:" + str(site_x)
    site_x = convert_meter_to_unit(site_x)
    site_y = convert_meter_to_unit(site_y)
    site_z = convert_meter_to_unit(site_z)
    ref_level_z = convert_meter_to_unit(ref_level_z)
    # print "site x after conversion:" + str(site_x)

    ###############################################################
    # Delete all levels apart from the reference level (when there are multiple levels)
    ###############################################################
    # Collect all levels
    levelArray = (FilteredElementCollector(doc)
        .OfCategory(BuiltInCategory.OST_Levels)
        .WhereElementIsNotElementType()
        .ToElements())

    # Delete all the non-level elements
    #view = doc.ActiveView.Id
    #collector = FilteredElementCollector(doc, view)
    #allLevels = FilteredElementCollector(doc).OfClass(Level).ToElements()
    #excludes = List[ElementId](allLevels)
    #Filter  =  ExclusionFilter(excludes)
    #allElements = collector.WherePasses(Filter).WhereElementIsNotElementType().ToElements()
    #allElements = FilteredElementCollector(doc).OfClass(Autodesk.Revit.DB.SpatialElement).WherePasses(Filter).ToElements()
    #for element in reversed(allElements):
    #   doc.Delete(element.Id)
    
    def clear_model(bool_value):
        if bool_value:
            del_grid = FilteredElementCollector(doc).OfCategory(BuiltInCategory.OST_Grids).WhereElementIsNotElementType().ToElements()
            del_door = FilteredElementCollector(doc).OfCategory(BuiltInCategory.OST_Doors).WhereElementIsNotElementType().ToElements()
            del_floor = FilteredElementCollector(doc).OfCategory(BuiltInCategory.OST_Floors).WhereElementIsNotElementType().ToElements()
            del_wall = FilteredElementCollector(doc).OfCategory(BuiltInCategory.OST_Walls).WhereElementIsNotElementType().ToElements()
            del_roof = FilteredElementCollector(doc).OfCategory(BuiltInCategory.OST_Roofs).WhereElementIsNotElementType().ToElements()
            del_all = [del_grid, del_door, del_floor, del_wall, del_roof]
            for element_type in del_all:
                for element in element_type:
                    doc.Delete(element.Id)

    clear_model(True)

    # Check the number of the existing levels, if multiple, delete and save only one
    if levelArray.Count > 1:
        #print "levelArray.Count > 1, from 01_Site"
        for levelElement in levelArray:
            if levelElement.Elevation != ref_level_z:
                doc.Delete(levelElement.Id)
    ref_level = levelArray[0]
    ref_level.Name = "Story Level 0"

    # Check the if the saved one is the reference level, correct it if not
    if ref_level.Elevation != ref_level_z:
        ref_level_new = Autodesk.Revit.DB.Level.Create(doc, ref_level_z)
        doc.Delete(ref_level.Id)
        ref_level = ref_level_new
        ref_level.Name = "Story Level 0"

    #--------------------------------------------------------------
    #------------------ OK NOW YOU CAN CODE -----------------------
    #--------------------------------------------------------------

    # Create Bounding Box
    bb = BoundingBoxXYZ()
    bb.Min = XYZ(0, 0, 0)
    bb.Max = XYZ(0, 0, site_z)
    bbox_site.append(bb.ToProtoType())                  # the bounding box of the entire site
    # Close and save the recording file
    # geo_site.append(site_x)
    # geo_site.append(site_y)
    # geo_site.append(site_z)

    ###############################################################
    # END OF SCRIPT 1
    # START OF SCRIPT 2
    ###############################################################

    archive_data = []                                                   # archive all the input data
    bbox_story = []
    exterior_wall_list = []
    floor_list = []
    roof_list = []
    entrance_door_list = []

    ###############################################################
    # Convert the Units | b = UnitUtils.ConvertToInternalUnits(a, UnitTypeId.Meters)  b = a*3 | c = UnitUtils.ConvertFromInternalUnits(a, UnitTypeId.Meters)  c = a*3
    ###############################################################
    story_z = convert_meter_to_unit(story_z)

    # Collect all levels
    levelArray = (FilteredElementCollector(doc)
        .OfCategory(BuiltInCategory.OST_Levels)
        .WhereElementIsNotElementType()
        .ToElements())

    # Check the number of the existing levels, if multiple, delete and save only one
    if levelArray.Count > 1:
        #print "levelArray.Count > 1, from 02_Story"
        for levelElement in levelArray:
            if levelElement.Elevation != ref_level.Elevation:
                doc.Delete(levelElement.Id)
    ref_level = levelArray[0]
    ref_level.Name = "Story Level 0"

    # Check the if the saved one is the reference level, correct it if not
    if ref_level.Elevation != 0:
        ref_level_new = Autodesk.Revit.DB.Level.Create(doc, 0)
        doc.Delete(ref_level.Id)
        ref_level = ref_level_new
        ref_level.Name = "Story Level 0"

    ###############################################################
    # Check the consistence with the bouning box of the side 
    ###############################################################
    # Check the z-position of the highest story against the site box

    check_site_story = True if max(story_z) < site_z else False
    #print "The stories are consistent with the overal site:" + str(check_site_story)

    # Create new story levels
    for ii in range(number_story):
        if ref_level.Elevation == story_z[ii]:
            continue
        new_level = Autodesk.Revit.DB.Level.Create(doc, story_z[ii])
        new_level.Name = "Story Level " + str(ii)

    # Create the roof level
    roof_level = Autodesk.Revit.DB.Level.Create(doc, site_z)
    roof_level.Name = "Roof Level"

    # all levels
    allLevels = FilteredElementCollector(doc).OfClass(Level).ToElements()

    # Create Bounding Box for each story level
    for ii in range(number_story):
        level_bbox_end_z = story_z[ii+1] if ii < (number_story-1) else site_z
        #print "Story"+str(ii)
        #print str(level_bbox_end_z)
        bb = BoundingBoxXYZ()
        bb.Min = XYZ(0, 0, story_z[ii])
        bb.Max = XYZ(site_x, site_y, level_bbox_end_z)
        bbox_story.append(bb.ToProtoType())

    # Create the exterior walls
    perimeter_lines = find_perimeter_lines(site_x, site_y, ref_level.Elevation)
    for ww in range(4):
        wall = Wall.Create(doc, perimeter_lines[ww], default_exterior_wall_type.Id, ref_level.Id, site_z, 0, False, True)
        exterior_wall_list.append(wall)
        
    # Create z-wall
    if percentage_z_wall_position != 0.:
        z_wall_lines = z_wall_perimeter_lines(percentage_z_wall_position, site_x, site_y, ref_level.Elevation)
        for line in z_wall_lines:
            #find_perimeter_lines(site_x, site_y, ref_level.Elevation)
            wall_z = Wall.Create(doc, line, default_exterior_wall_type.Id, ref_level.Id, site_z, 0, False, True)
        
        # Create the opening
        #start_point = XYZ(0.5 * site_x - 0.5, 0.25 * site_y, ref_level.Elevation)
        #end_point = XYZ(0.5 * site_x + 0.5, 0.25 * site_y + 1.0, ref_level.Elevation + 2.)
        start_point = XYZ(convert_meter_to_unit(0.5 * site_x - 0.5), convert_meter_to_unit(0.25 * site_y), convert_meter_to_unit(ref_level.Elevation))
        end_point = XYZ(convert_meter_to_unit(0.5 * site_x + 0.5), convert_meter_to_unit(0.25 * site_y + 1.0), convert_meter_to_unit(ref_level.Elevation+2.))#+15)	
        
        #start_point = XYZ(convert_meter_to_unit(0.5 * site_x - 0.5), convert_meter_to_unit(0.25 * site_y), ref_level.Elevation)
        #end_point = XYZ(convert_meter_to_unit(0.5 * site_x + 0.5), convert_meter_to_unit(0.25 * site_y + 1.0), ref_level.Elevation + convert_meter_to_unit(2.))
        #print "start opening: " + str(start_point)
        #print "start end: " + str(end_point)
        opening = doc.Create.NewOpening(wall_z, start_point, end_point)


    # Create floor for each story level
    for ii in range(number_story):
        ll = allLevels[ii]
        floor_geometry = slab_geometry_by_level(site_x, site_y, ll, 0.0)
        floor = doc.Create.NewFloor(floor_geometry, default_floor_type, ll, True)
        floor_list.append(floor)

    ###############################################################
    # END OF SCRIPT 2
    # START OF SCRIPT 3
    ###############################################################

    width_y_rooms_right = site_y / number_rooms_right_side
    width_y_rooms_left = site_y / number_rooms_left_side

    # Create room dict
    room_dict = {}

    # Create room-corridor walls
    corridor_wall_all_level = []
    corr_room_lines = [
        # left wall
        Autodesk.Revit.DB.Line.CreateBound(
            XYZ(percentage_room_width * site_x, 0, allLevels[0].Elevation), 
            XYZ(percentage_room_width * site_x,	site_y, allLevels[0].Elevation)
        ),
        # right wall
        Autodesk.Revit.DB.Line.CreateBound(
            XYZ(site_x * (1-percentage_room_width), 0, allLevels[0].Elevation),
            XYZ(site_x * (1-percentage_room_width),	site_y, allLevels[0].Elevation)
        ),
    ]

    # Create corridor-room walls
    for wall_line in corr_room_lines:
        corridor_wall = Wall.Create(doc, wall_line, default_interior_wall_type.Id, allLevels[0].Id, allLevels[1].Elevation - allLevels[0].Elevation, 0, False, True)
        corridor_wall_all_level.append(corridor_wall)

    left_room_lines = []
    right_room_lines = []

    # print "site x back to meters:" + str(convert_to_meter(site_x)) + "\n"

    # Create room-room lines
    for nn in range(int(number_rooms_left_side)-1):
        wall_line = Autodesk.Revit.DB.Line.CreateBound(
            XYZ(0,								(nn+1)*width_y_rooms_left, 	allLevels[0].Elevation), 
            XYZ(percentage_room_width * site_x,	(nn+1)*width_y_rooms_left,	allLevels[0].Elevation)
        )
        left_room_lines.append(wall_line)
        corridor_wall = Wall.Create(doc, wall_line, default_interior_wall_type.Id, allLevels[0].Id, allLevels[1].Elevation - allLevels[0].Elevation, 0, False, True)

    for nn in range(int(number_rooms_right_side)-1):
        wall_line = Autodesk.Revit.DB.Line.CreateBound(
            XYZ(site_x * (1-percentage_room_width),	(nn+1)*width_y_rooms_right,	allLevels[0].Elevation), 
            XYZ(site_x,								(nn+1)*width_y_rooms_right,	allLevels[0].Elevation)
        )        
        right_room_lines.append(wall_line)
        corridor_wall = Wall.Create(doc, wall_line, default_interior_wall_type.Id, allLevels[0].Id, allLevels[1].Elevation - allLevels[0].Elevation, 0, False, True)

    ############################################################################################################
    # POTENTIALLY BUILD IN ROOM SIZE CHECK FOR SPAWN AND DESTINATION AREAS (OR DO THAT WITH THE INPUT PARAMTERS)
    ############################################################################################################

    # door parameters for openings
    wall_thickness = convert_meter_to_unit(0.5)
    door_width = convert_meter_to_unit(1.)
    door_height = convert_meter_to_unit(2.)

    # create corridor-wall openings on the left side
    for nn in range(int(number_rooms_left_side)):
        start_point = XYZ(percentage_room_width * site_x - wall_thickness/2.,	(2*nn+1)/2.*width_y_rooms_left - door_width/2.,	allLevels[0].Elevation)
        end_point = XYZ(percentage_room_width * site_x + wall_thickness/2.,		(2*nn+1)/2.*width_y_rooms_left + door_width/2., allLevels[0].Elevation + door_height)
        opening = doc.Create.NewOpening(corridor_wall_all_level[0], start_point, end_point)
        # print "left line " + str(nn) + " coords: P1=(" + str(0) + ", " + str((nn+1)*width_y_rooms_left)  + \
        #     \
        #     ")\t\t vs. to meter: (" + str(convert_to_meter(0)) + ", " + str(convert_to_meter((nn+1)*width_y_rooms_left)) + ")"
        # print "left line " + str(nn) + " coords: P2=(" + str(percentage_room_width * site_x) + ", " + str((nn+1)*width_y_rooms_left)  + \
        #     \
        #     ")\t\t vs. to meter: (" + str(convert_to_meter(percentage_room_width * site_x)) + ", " + str(convert_to_meter((nn+1)*width_y_rooms_left)) + ")\n"

        # Append rooms to room_dict
        room_dict.update(
            {
                str(nn)+'_left': [
                    (0, convert_to_meter(nn * width_y_rooms_left)),
                    (convert_to_meter(percentage_room_width * site_x), convert_to_meter((nn+1)*width_y_rooms_left))
                ]
            }
        )

    # create corridor-wall openings on the right side
    for nn in range(int(number_rooms_right_side)):
        start_point = XYZ(site_x * (1-percentage_room_width) - wall_thickness/2.,	(2*nn+1)/2.*width_y_rooms_right - door_width/2.,	allLevels[0].Elevation)
        end_point = XYZ(site_x * (1-percentage_room_width) + wall_thickness/2.,		(2*nn+1)/2.*width_y_rooms_right + door_width/2., allLevels[0].Elevation + door_height)
        opening = doc.Create.NewOpening(corridor_wall_all_level[1], start_point, end_point)
        # print "right line " + str(nn) + " coords: P1=(" + str(site_x * (1-percentage_room_width)) + ", " + str((nn+1)*width_y_rooms_right)  + \
        #     \
        #     ")\t\t vs. to meter: (" + str(convert_to_meter(site_x * (1-percentage_room_width))) + ", " + str(convert_to_meter((nn+1)*width_y_rooms_right)) + ")"
        # print "right line " + str(nn) + " coords: P2=(" + str(site_x) + ", " + str((nn+1)*width_y_rooms_right)  + \
        #     \
        #     ")\t\t vs. to meter: (" + str(convert_to_meter(site_x)) + ", " + str(convert_to_meter((nn+1)*width_y_rooms_right)) + ")\n"

        # Append rooms to room_dict
        room_dict.update({
            str(nn)+'_right': [
                    (convert_to_meter(site_x * (1-percentage_room_width)), convert_to_meter(nn * width_y_rooms_right)),
                    (convert_to_meter(site_x), convert_to_meter((nn+1)*width_y_rooms_right))
                ]
            }
        )

    # Save rooms into log file
    for key in room_dict:
        print "ROOM_"+key
        for coord in room_dict[key]:
            print "COORD_"+str(coord[0])+","+str(coord[1])
        print ""

    sys.stdout = stdout_original
    stdout_file.close()
#--------------------------------------------------------------
#------------------ OK NOW END THE CODE -----------------------
#--------------------------------------------------------------

TransactionManager.Instance.TransactionTaskDone()

###############################################################
# Prepare the output 
###############################################################
OUT = txt_filename
# ----------------------------------------
watch = Watch(create_everything)
directory_path = Directory("C:\Users\ga78jem\Documents\Revit\Exports")
create_folder_structure = BoolSelector(true)
create_folders = Python(IN[0]=create_everything, IN[1]=directory_path, IN[2]=create_folder_structure)  # IronPython2; graph output
# ---------- create_folders.python (41 lines) ----------
# Phython-Standard- und DesignScript-Bibliotheken laden
import sys
import clr
clr.AddReference('ProtoGeometry')
from Autodesk.DesignScript.Geometry import *
import os
import shutil

clr.AddReference("RevitServices")
import RevitServices
from RevitServices.Persistence import DocumentManager 
doc = DocumentManager.Instance.CurrentDBDocument

# Die Eingaben für diesen Block werden in Form einer Liste in den IN-Variablen gespeichert.
dataEnteringNode = IN

# Code unterhalb dieser Linie platzieren

txt_filename = IN[0]
store_dir = IN[1]
create_folder_structure = IN[2]

new_folder_name = None

if create_folder_structure and txt_filename != None:

	new_folder_name = txt_filename.replace('.txt', '')

	for dirname in os.listdir(store_dir):
		assert new_folder_name != dirname.split('__')[-1], 'Duplicate settings!'

	prefix = str(len(os.listdir(store_dir)))+'__'
	new_folder_name = os.path.join(store_dir, prefix+new_folder_name)

	os.mkdir(new_folder_name)
	shutil.move(txt_filename, new_folder_name)
	txt_filename.replace('.txt', '')

#doc.Regenerate()
# Weisen Sie Ihre Ausgabe der OUT-Variablen zu.
OUT = [new_folder_name, txt_filename]
# ----------------------------------------
watch_2 = Watch(create_folders)
getFolderpath = Python(IN[0]=directory_path, IN[1]=percentage_z_wall_position, IN[2]=percentage_room_width, IN[3]=rooms_per_side_left, IN[4]=rooms_per_side_right, IN[5]=create_mode)  # IronPython2
# ---------- getFolderpath.python (50 lines) ----------
# Phython-Standard- und DesignScript-Bibliotheken laden
import sys
import clr
clr.AddReference('ProtoGeometry')
from Autodesk.DesignScript.Geometry import *
import os
import shutil

# Die Eingaben für diesen Block werden in Form einer Liste in den IN-Variablen gespeichert.
dataEnteringNode = IN

# Code unterhalb dieser Linie platzieren


store_dir = IN[0]
percentage_z_wall_position = IN[1]
percentage_room_width = IN[2]
number_rooms_left_side = IN[3]
number_rooms_right_side = IN[4]
do_create = IN[5]

percentage_z_wall_position /= 100
percentage_room_width/= 100

save_file = ''

dxf_filename = 'floorplan_zPos_' + str(percentage_z_wall_position)
dxf_filename += "_roomWidth_" + str(percentage_room_width)
dxf_filename += "_numRleft_" + str(number_rooms_left_side)
dxf_filename += "_numRright_" + str(number_rooms_right_side)
new_folder_name = dxf_filename
txt_filename = dxf_filename + '.txt'
dxf_filename += ".dxf"

foldername = None
foldername_count = 0

if not do_create:
	for dirname in os.listdir(store_dir):
		if new_folder_name == dirname.split('__')[-1]:
			foldername = dirname
			foldername_count += 1
			
	assert foldername_count == 1
	assert foldername != None
		
	foldername = os.path.join(store_dir, foldername)

# Weisen Sie Ihre Ausgabe der OUT-Variablen zu.
OUT = foldername
# ----------------------------------------
watch_3 = Watch(getFolderpath)
element_types = ElementTypes("ViewPlan")
all_elements_of_type = ElementsOfType(element_type=element_types)
watch_4 = Watch(all_elements_of_type)
code_block = CodeBlock(IN=watch_4) { OUT=IN[0]; }
id = Element.Id(element=code_block)
export2dxf_py = Python(IN[0]=getFolderpath, IN[1]=id)  # IronPython2
# ---------- export2dxf_py.python (54 lines) ----------
# Phython-Standard- und DesignScript-Bibliotheken laden
import sys
import os
import clr
clr.AddReference('ProtoGeometry')
from Autodesk.DesignScript.Geometry import *

clr.AddReference("RevitNodes")
import Revit

clr.ImportExtensions(Revit.Elements)
clr.ImportExtensions(Revit.GeometryConversion)

clr.AddReference("RevitServices")
import RevitServices
from RevitServices.Persistence import DocumentManager 
from RevitServices.Transactions import TransactionManager 

# Import RevitAPI
clr.AddReference("RevitAPI")
import Autodesk
from Autodesk.Revit.DB import *

clr.AddReference('System')
#from System.Collections.Generic import *
from System.Collections.Generic import List

# Die Eingaben für diesen Block werden in Form einer Liste in den IN-Variablen gespeichert.
dataEnteringNode = IN

# Code unterhalb dieser Linie platzieren
###############################################################
# Current doc/app/ui
###############################################################
doc = DocumentManager.Instance.CurrentDBDocument

folderPath = IN[0]
viewId = IN[1]

def ExportDxf(name, id, folder, filename):
	options = DXFExportOptions()
	options.TargetUnit = ExportUnit.Meter
	views = List[ElementId]()
	views.Add(ElementId(id))
	result = doc.Export(folder, name, views, options)
	return result

if folderPath != None: 
	filename = folderPath.split('__')[-1].split('\\')[-1] + '.dxf'
	assert not os.path.isfile(os.path.join(folderPath, filename))
	ExportDxf(filename, viewId, folderPath, filename)

#Assign your output to the OUT variable
OUT = viewId
# ----------------------------------------
watch_5 = Watch(export2dxf_py)
export2pdf_py = Python(IN[0]=getFolderpath, IN[1]=id)  # IronPython2
# ---------- export2pdf_py.python (54 lines) ----------
# Phython-Standard- und DesignScript-Bibliotheken laden
import sys
import os
import clr
clr.AddReference('ProtoGeometry')
from Autodesk.DesignScript.Geometry import *

clr.AddReference("RevitNodes")
import Revit

clr.ImportExtensions(Revit.Elements)
clr.ImportExtensions(Revit.GeometryConversion)

clr.AddReference("RevitServices")
import RevitServices
from RevitServices.Persistence import DocumentManager 
from RevitServices.Transactions import TransactionManager 

# Import RevitAPI
clr.AddReference("RevitAPI")
import Autodesk
from Autodesk.Revit.DB import *

clr.AddReference('System')
#from System.Collections.Generic import *
from System.Collections.Generic import List

# Die Eingaben für diesen Block werden in Form einer Liste in den IN-Variablen gespeichert.
dataEnteringNode = IN

# Code unterhalb dieser Linie platzieren
###############################################################
# Current doc/app/ui
###############################################################
doc = DocumentManager.Instance.CurrentDBDocument
folderPath = IN[0]
viewId = IN[1]
	
def ExportPdf(id, folder, filename):
	options = PDFExportOptions()
	options.FileName = filename
	#options.TargetUnit = ExportUnit.Meter
	views = List[ElementId]()
	views.Add(ElementId(id))
	result = doc.Export(folder, views, options)
	return result

if folderPath != None: 
	filename = folderPath.split('__')[-1].split('\\')[-1]
	assert not os.path.isfile(os.path.join(folderPath, filename+'.pdf'))
	ExportPdf(viewId, folderPath, filename)

#Assign your output to the OUT variable
OUT = viewId
# ----------------------------------------
watch_6 = Watch(export2pdf_py)
