# Dynamo graph 20220704_CORR_CROSS_script_with_export_switch_ADVANCED.dyn (Dynamo 2.10.1.3976)

# group: Input parameters
SITE_X = DoubleSlider(60, range=20..70 step 5)  # graph input
SITE_Y = DoubleSlider(25, range=15..50 step 5)  # graph input
corridor_width = DoubleSlider(3, range=2..4 step 1)  # graph input
side_corridors_width_2_dynamo = DoubleSlider(6, range=4..6 step 1)  # "SIDE CORRIDORS WIDTH * 2. (Dynamo Player cant do floats)"; graph input
NUM_CROSSINGS = IntegerSlider(4, range=1..5 step 1)  # graph input

parameter_processing = Python(IN[0]=SITE_X, IN[1]=SITE_Y, IN[2]=corridor_width, IN[3]=side_corridors_width_2_dynamo, IN[4]=NUM_CROSSINGS)  # IronPython2
# ---------- parameter_processing.python (29 lines) ----------
# Phython-Standard- und DesignScript-Bibliotheken laden
import sys
import os
import clr
clr.AddReference('ProtoGeometry')
from Autodesk.DesignScript.Geometry import *

# Die Eingaben für diesen Block werden in Form einer Liste in den IN-Variablen gespeichert.
dataEnteringNode = IN

# Code unterhalb dieser Linie platzieren
site_x = int(IN[0])                                # the overall length of the site
site_y = int(IN[1])                                # the overall widthness of the site
CORR_WIDTH = int(IN[2]) # convert_meter_to_unit(3)
SIDE_CORR_WIDTH = float(IN[3])/2.
NUM_CROSSINGS = int(IN[4]) # 1 = 'right_left', 2 = 'left_right'
#store_dir = IN[6]
#layout_name = IN[7]

assert NUM_CROSSINGS >= 1

SIDE_CORR_WIDTH_STR = str(SIDE_CORR_WIDTH)
if '.' in SIDE_CORR_WIDTH_STR:
    SIDE_CORR_WIDTH_STR = SIDE_CORR_WIDTH_STR.replace('.','')

txt_filename = \
    'floorplan_siteX_'+str(int(site_x))+'_siteY_'+str(int(site_y))+'_CORRWIDTH_'+str(CORR_WIDTH)+'_SIDECORRWIDTH_'+str(SIDE_CORR_WIDTH_STR)+'_numCross_'+str(NUM_CROSSINGS)+'.txt'
# Weisen Sie Ihre Ausgabe der OUT-Variablen zu.
OUT = txt_filename, [site_x, site_y, CORR_WIDTH, SIDE_CORR_WIDTH, NUM_CROSSINGS]
# ----------------------------------------
true_create_building_false = BoolSelector(false)  # "True== Create Building // False==Export Floorplan"; graph input; graph output
directory_path = Directory("C:\Users\ga78jem\Documents\Revit\Exports_ADVANCED")
string = StringInput("corr_cross")
create_folder_structure = BoolSelector(false)  # graph input
create_folder = Python(IN[0]=parameter_processing, IN[1]=true_create_building_false, IN[2]=directory_path, IN[3]=string, IN[4]=create_folder_structure)  # IronPython2; graph output
# ---------- create_folder.python (59 lines) ----------
# Phython-Standard- und DesignScript-Bibliotheken laden
import sys
import clr
clr.AddReference('ProtoGeometry')
from Autodesk.DesignScript.Geometry import *
import os
import shutil

clr.AddReference("RevitServices")
import RevitServices
from RevitServices.Persistence import DocumentManager 
doc = DocumentManager.Instance.CurrentDBDocument

# Die Eingaben für diesen Block werden in Form einer Liste in den IN-Variablen gespeichert.
dataEnteringNode = IN

# Code unterhalb dieser Linie platzieren

txt_filename = IN[0][0]
do_create = IN[1]
store_dir = IN[2]
layout_name = str(IN[3])
create_folder_structure = IN[4]

new_folder_name = None
txt_filepath = None

if create_folder_structure:

	dataset_folder_name = os.path.join(store_dir, layout_name)
	if not os.path.isdir(dataset_folder_name): os.mkdir(dataset_folder_name)
	
	new_folder_name = txt_filename.replace('.txt', '')
	# only check for duplicate settings when creating a new subfolder corresponding to the settings
	prefix = None
	if do_create:
		if len(os.listdir(dataset_folder_name)) > 0:
			for dirname in os.listdir(dataset_folder_name):
				assert new_folder_name != dirname.split('__')[-1], 'Duplicate settings!'
		prefix = str(len(os.listdir(dataset_folder_name)))+'__'
	
	elif not do_create:
		for dirname in os.listdir(dataset_folder_name):
			if new_folder_name == dirname.split('__')[-1]:
				prefix = dirname.split('__')[0] + '__'
	
	assert prefix, 'folder prefix is empty or doesnt exist, probably because a folder does not exist'
	new_folder_name = prefix+new_folder_name
	new_folder_name = os.path.join(dataset_folder_name, new_folder_name)
	
	# dont create the folder when exporting (it should already be there from the previous step...
	if do_create:
		os.mkdir(new_folder_name)
	#shutil.move(txt_filename, new_folder_name)
	txt_filepath = os.path.join(new_folder_name, txt_filename)

#doc.Regenerate()
# Weisen Sie Ihre Ausgabe der OUT-Variablen zu.
OUT = txt_filepath, do_create
# ----------------------------------------

# group: Floorplan View
element_types = ElementTypes("ViewPlan")
all_elements_of_type = ElementsOfType(element_type=element_types)
watch = Watch(all_elements_of_type)
code_block = CodeBlock(IN=watch) { OUT=IN[0]; }
id = Element.Id(element=code_block)

export2dxf_py = Python(IN[0]=create_folder, IN[1]=id)  # IronPython2
# ---------- export2dxf_py.python (59 lines) ----------
# Phython-Standard- und DesignScript-Bibliotheken laden
import sys
import os
import clr
clr.AddReference('ProtoGeometry')
from Autodesk.DesignScript.Geometry import *

clr.AddReference("RevitNodes")
import Revit

clr.ImportExtensions(Revit.Elements)
clr.ImportExtensions(Revit.GeometryConversion)

clr.AddReference("RevitServices")
import RevitServices
from RevitServices.Persistence import DocumentManager 
from RevitServices.Transactions import TransactionManager 

# Import RevitAPI
clr.AddReference("RevitAPI")
import Autodesk
from Autodesk.Revit.DB import *

clr.AddReference('System')
#from System.Collections.Generic import *
from System.Collections.Generic import List

# Die Eingaben für diesen Block werden in Form einer Liste in den IN-Variablen gespeichert.
dataEnteringNode = IN

# Code unterhalb dieser Linie platzieren
###############################################################
# Current doc/app/ui
###############################################################
doc = DocumentManager.Instance.CurrentDBDocument

txt_filepath = IN[0][0]
do_create = IN[0][1]
viewId = IN[1]

def ExportDxf(name, id, folder, filename):
	options = DXFExportOptions()
	options.TargetUnit = ExportUnit.Meter
	views = List[ElementId]()
	views.Add(ElementId(id))
	result = doc.Export(folder, name, views, options)
	return result

fullpath = None
if not do_create and txt_filepath: 
	folderPath = '\\'.join(txt_filepath.split('\\')[:-1])
	filename = txt_filepath.split('\\')[-1].replace('.txt', '.dxf')
	
	assert not os.path.isfile(os.path.join(folderPath, filename)), '.dxf already exists!'
	ExportDxf(filename, viewId, folderPath, filename)
	fullpath = txt_filepath.replace('.txt', '.dxf')

#Assign your output to the OUT variable
OUT = fullpath
# ----------------------------------------
watch_2 = Watch(export2dxf_py)
export2pdf_py = Python(IN[0]=create_folder, IN[1]=id)  # IronPython2
# ---------- export2pdf_py.python (62 lines) ----------
# Phython-Standard- und DesignScript-Bibliotheken laden
import sys
import os
import clr
clr.AddReference('ProtoGeometry')
from Autodesk.DesignScript.Geometry import *

clr.AddReference("RevitNodes")
import Revit

clr.ImportExtensions(Revit.Elements)
clr.ImportExtensions(Revit.GeometryConversion)

clr.AddReference("RevitServices")
import RevitServices
from RevitServices.Persistence import DocumentManager 
from RevitServices.Transactions import TransactionManager 

# Import RevitAPI
clr.AddReference("RevitAPI")
import Autodesk
from Autodesk.Revit.DB import *

clr.AddReference('System')
#from System.Collections.Generic import *
from System.Collections.Generic import List

# Die Eingaben für diesen Block werden in Form einer Liste in den IN-Variablen gespeichert.
dataEnteringNode = IN

# Code unterhalb dieser Linie platzieren
###############################################################
# Current doc/app/ui
###############################################################
doc = DocumentManager.Instance.CurrentDBDocument
txt_filepath = IN[0][0]
do_create = IN[0][1]
viewId = IN[1]
	
def ExportPdf(id, folder, filename):
	options = PDFExportOptions()
	options.FileName = filename
	#options.TargetUnit = ExportUnit.Meter
	views = List[ElementId]()
	views.Add(ElementId(id))
	result = doc.Export(folder, views, options)
	return result

full_path = None
if not do_create and txt_filepath:
	folderPath = '\\'.join(txt_filepath.split('\\')[:-1])
	filename = txt_filepath.split('\\')[-1].replace('.txt', '')
	#filename = folderPath.split('__')[-1].split('\\')[-1]
	#filename = txt_folderpath.replace('.txt', '')
	
	assert not os.path.isfile(txt_filepath.replace('.txt', '.pdf')), '.dxf already exists!'
	
	ExportPdf(viewId, folderPath, filename)
	full_path = txt_filepath.replace('.txt', '.pdf')

#Assign your output to the OUT variable
OUT = full_path
# ----------------------------------------
watch_3 = Watch(export2pdf_py)

# group: Wall & Floor Types
default_exterior_wall_types = WallTypes("Generic - 300mm")
default_floor_types = FloorTypes("Generic 150mm - Filled")
default_interior_wall_types = WallTypes("Generic - 200mm")

create_corridor_crossings = Python(IN[0]=default_exterior_wall_types, IN[1]=default_floor_types, IN[2]=default_interior_wall_types, IN[3]=parameter_processing, IN[4]=true_create_building_false)  # IronPython2
# ---------- create_corridor_crossings.python (464 lines) ----------
###############################################################
# Load the Libraries
###############################################################
import os
import clr
import sys
import math
import System

from System import Array
from System.Collections.Generic import *

clr.AddReference("RevitNodes")
import Revit

clr.ImportExtensions(Revit.Elements)
clr.ImportExtensions(Revit.GeometryConversion)

clr.AddReference("RevitServices")
import RevitServices
from RevitServices.Persistence import DocumentManager 
from RevitServices.Transactions import TransactionManager 

clr.AddReference("RevitAPI")
clr.AddReference("RevitAPIUI")

clr.AddReference('ProtoGeometry')
import Autodesk 
from Autodesk.DesignScript.Geometry import *
from Autodesk.Revit.DB import *
#from Autodesk.Revit.UI import *
from Autodesk.Revit.DB import StairsEditScope
from Autodesk.Revit.DB import Parameter
from Autodesk.Revit.DB.Architecture import StairsRun
from Autodesk.Revit.DB.Architecture import *
from Autodesk.Revit.DB import IFailuresPreprocessor

###############################################################
# Customize functions 
###############################################################
"""
Converts default unit in Dynamo into meter...
"""
def convert_meter_to_unit(pre_value):
    tempo_list = []
    tempo_value = 0
    if isinstance(pre_value, list):
        len_list = len(pre_value)
        for ii in range(len_list):
            tempo_list.append (float(UnitUtils.ConvertToInternalUnits(pre_value[ii], UnitTypeId.Meters)))
        pre_value = tempo_list
    else:
        tempo_value = float(UnitUtils.ConvertToInternalUnits(pre_value, UnitTypeId.Meters))
        pre_value = tempo_value
    return pre_value


def convert_to_meter(internal_value):
	if isinstance(internal_value, list):
		return [UnitUtils.ConvertFromInternalUnits(value, UnitTypeId.Meters) for value in internal_value]
	return float(UnitUtils.ConvertFromInternalUnits(internal_value, UnitTypeId.Meters))

"""
Provide perimeter lines from three dimensions...
"""
def find_perimeter_lines(x,y,z):
    line_list = []
    xx = x
    yy = y
    zz = z 
    # print "find_perimeter_lines x: " + str(x)
    # print "find_perimeter_lines y: " + str(y)
    # print "find_perimeter_lines z: " + str(z)
	
    line_1 = Autodesk.Revit.DB.Line.CreateBound(XYZ(0,0,zz),    XYZ(xx,0,zz))
    line_2 = Autodesk.Revit.DB.Line.CreateBound(XYZ(xx,0,zz),   XYZ(xx,yy,zz))
    line_3 = Autodesk.Revit.DB.Line.CreateBound(XYZ(xx,yy,zz),  XYZ(0,yy,zz))
    line_4 = Autodesk.Revit.DB.Line.CreateBound(XYZ(0,yy,zz),   XYZ(0,0,zz))

    line_list.append(line_1)
    line_list.append(line_2)
    line_list.append(line_3)
    line_list.append(line_4)
    
    return line_list

"""
Provide the geometry of slab by level...
"""
def slab_geometry_by_level(x,y,level,delta_z):
    zz = level.Elevation + delta_z
    xx = x
    yy = y 
    line_1 = Autodesk.Revit.DB.Line.CreateBound(XYZ(0,0,zz),    XYZ(xx,0,zz))
    line_2 = Autodesk.Revit.DB.Line.CreateBound(XYZ(xx,0,zz),   XYZ(xx,yy,zz))
    line_3 = Autodesk.Revit.DB.Line.CreateBound(XYZ(xx,yy,zz),  XYZ(0,yy,zz))
    line_4 = Autodesk.Revit.DB.Line.CreateBound(XYZ(0,yy,zz),   XYZ(0,0,zz))
    
    slab_geometry = CurveArray()
    slab_geometry.Append(line_1)
    slab_geometry.Append(line_2)
    slab_geometry.Append(line_3)
    slab_geometry.Append(line_4)
    return slab_geometry

###############################################################
# Current doc/app/ui
###############################################################
doc = DocumentManager.Instance.CurrentDBDocument
# uiapp = DocumentManager.Instance.CurrentUIApplication 
# app = uiapp.Application
# uidoc = uiapp.ActiveUIDocument

###############################################################
# Prepare the input
###############################################################
default_exterior_wall_type = UnwrapElement(IN[0])                   # Default exterior wall type
default_floor_type = UnwrapElement(IN[1])                           # Default Floor type
default_interior_wall_type = UnwrapElement(IN[2])				# Default interior wall type
### INPUT PARAMETERS ###
parameter_list = IN[3][1]
site_x = parameter_list[0]                                # the overall length of the site
site_y = parameter_list[1]                                # the overall widthness of the site
CORR_WIDTH = parameter_list[2] # convert_meter_to_unit(3)
SIDE_HALLWAY_WIDTH = parameter_list[3]
NUM_CROSSINGS = parameter_list[4]
create_mode = IN[4]

number_story = 1                                          # the total amount of the stories;
story_z = [0]
site_z = 4                                              # the overall height of the site
ref_level_z = 0                                         # the z-position of the reference level (default level = level 0, created in the prepared .rvt)
###############################################################
# Transaction in Revit
###############################################################
TransactionManager.Instance.EnsureInTransaction(doc)
###############################################################
# Define the output
###############################################################

# Create room dict
room_dict = {}

if create_mode:
    geo_site = []                                                       # archive all the input data
    ref_level = []                                                      # the reference level
    bbox_site = []                                                      # bounding box of the site

    # sys.path.append('C:\Users\ga78jem\Miniconda3\envs\trajectron++\Lib\site-packages')

    ###############################################################
    # Convert the Units | b = UnitUtils.ConvertToInternalUnits(a, UnitTypeId.Meters)  b = a*3 | c = UnitUtils.ConvertFromInternalUnits(a, UnitTypeId.Meters)  c = a*3
    ###############################################################

    # print "site x before conversion:" + str(site_x)
    site_x = convert_meter_to_unit(site_x)
    site_y = convert_meter_to_unit(site_y)
    site_z = convert_meter_to_unit(site_z)
    ref_level_z = convert_meter_to_unit(ref_level_z)
    CORR_WIDTH = convert_meter_to_unit(CORR_WIDTH)
    SIDE_HALLWAY_WIDTH = convert_meter_to_unit(SIDE_HALLWAY_WIDTH)
    # print "site x after conversion:" + str(site_x)

    ###############################################################
    # Delete all levels apart from the reference level (when there are multiple levels)
    ###############################################################
    # Collect all levels
    levelArray = (FilteredElementCollector(doc)
        .OfCategory(BuiltInCategory.OST_Levels)
        .WhereElementIsNotElementType()
        .ToElements())

    def clear_model(bool_value):
        if bool_value:
            del_grid = FilteredElementCollector(doc).OfCategory(BuiltInCategory.OST_Grids).WhereElementIsNotElementType().ToElements()
            del_door = FilteredElementCollector(doc).OfCategory(BuiltInCategory.OST_Doors).WhereElementIsNotElementType().ToElements()
            del_floor = FilteredElementCollector(doc).OfCategory(BuiltInCategory.OST_Floors).WhereElementIsNotElementType().ToElements()
            del_wall = FilteredElementCollector(doc).OfCategory(BuiltInCategory.OST_Walls).WhereElementIsNotElementType().ToElements()
            del_roof = FilteredElementCollector(doc).OfCategory(BuiltInCategory.OST_Roofs).WhereElementIsNotElementType().ToElements()
            del_all = [del_grid, del_door, del_floor, del_wall, del_roof]
            for element_type in del_all:
                for element in element_type:
                    doc.Delete(element.Id)

    clear_model(True)

    # Check the number of the existing levels, if multiple, delete and save only one
    if levelArray.Count > 1:
        #print "levelArray.Count > 1, from 01_Site"
        for levelElement in levelArray:
            if levelElement.Elevation != ref_level_z:
                doc.Delete(levelElement.Id)
    ref_level = levelArray[0]
    ref_level.Name = "Story Level 0"

    # Check the if the saved one is the reference level, correct it if not
    if ref_level.Elevation != ref_level_z:
        ref_level_new = Autodesk.Revit.DB.Level.Create(doc, ref_level_z)
        doc.Delete(ref_level.Id)
        ref_level = ref_level_new
        ref_level.Name = "Story Level 0"

    #--------------------------------------------------------------
    #------------------ OK NOW YOU CAN CODE -----------------------
    #--------------------------------------------------------------

    # Create Bounding Box
    bb = BoundingBoxXYZ()
    bb.Min = XYZ(0, 0, 0)
    bb.Max = XYZ(0, 0, site_z)
    bbox_site.append(bb.ToProtoType())                  # the bounding box of the entire site
    # Close and save the recording file
    # geo_site.append(site_x)
    # geo_site.append(site_y)
    # geo_site.append(site_z)

    ###############################################################
    # END OF SCRIPT 1
    # START OF SCRIPT 2
    ###############################################################

    archive_data = []                                                   # archive all the input data
    bbox_story = []
    exterior_wall_list = []
    floor_list = []
    roof_list = []
    entrance_door_list = []

    ###############################################################
    # Convert the Units | b = UnitUtils.ConvertToInternalUnits(a, UnitTypeId.Meters)  b = a*3 | c = UnitUtils.ConvertFromInternalUnits(a, UnitTypeId.Meters)  c = a*3
    ###############################################################
    story_z = convert_meter_to_unit(story_z)

    # Collect all levels
    levelArray = (FilteredElementCollector(doc)
        .OfCategory(BuiltInCategory.OST_Levels)
        .WhereElementIsNotElementType()
        .ToElements())

    # Check the number of the existing levels, if multiple, delete and save only one
    if levelArray.Count > 1:
        #print "levelArray.Count > 1, from 02_Story"
        for levelElement in levelArray:
            if levelElement.Elevation != ref_level.Elevation:
                doc.Delete(levelElement.Id)
    ref_level = levelArray[0]
    ref_level.Name = "Story Level 0"

    # Check the if the saved one is the reference level, correct it if not
    if ref_level.Elevation != 0:
        ref_level_new = Autodesk.Revit.DB.Level.Create(doc, 0)
        doc.Delete(ref_level.Id)
        ref_level = ref_level_new
        ref_level.Name = "Story Level 0"

    ###############################################################
    # Check the consistence with the bouning box of the side 
    ###############################################################
    # Check the z-position of the highest story against the site box

    check_site_story = True if max(story_z) < site_z else False
    #print "The stories are consistent with the overal site:" + str(check_site_story)

    # Create new story levels
    for ii in range(number_story):
        if ref_level.Elevation == story_z[ii]:
            continue
        new_level = Autodesk.Revit.DB.Level.Create(doc, story_z[ii])
        new_level.Name = "Story Level " + str(ii)

    # Create the roof level
    roof_level = Autodesk.Revit.DB.Level.Create(doc, site_z)
    roof_level.Name = "Roof Level"

    # all levels
    allLevels = FilteredElementCollector(doc).OfClass(Level).ToElements()

    # Create Bounding Box for each story level
    for ii in range(number_story):
        level_bbox_end_z = story_z[ii+1] if ii < (number_story-1) else site_z
        #print "Story"+str(ii)
        #print str(level_bbox_end_z)
        bb = BoundingBoxXYZ()
        bb.Min = XYZ(0, 0, story_z[ii])
        bb.Max = XYZ(site_x, site_y, level_bbox_end_z)
        bbox_story.append(bb.ToProtoType())

    ##############################################################################################################################
    ##############################################################################################################################
    # Create floorplan complexity
    ##############################################################################################################################
    ##############################################################################################################################

    LENGTH = site_x
    WIDTH = site_y
    print 'x_length: ' + str(convert_to_meter(LENGTH))
    print 'y_width: ' + str(convert_to_meter(WIDTH))
    z_level = ref_level.Elevation
    ceiling = allLevels[0].Elevation

    DOOR_WIDTH_H = convert_meter_to_unit(0.5)
    DOOR_HEIGHT = convert_meter_to_unit(2.2)
    DOOR_THICKNESS_H = convert_meter_to_unit(0.25)

    # Create the exterior walls
    perimeter_lines = find_perimeter_lines(LENGTH, WIDTH, z_level)
    for ww in range(4):
        wall = Wall.Create(doc, perimeter_lines[ww], default_exterior_wall_type.Id, ref_level.Id, site_z, 0, False, True)
        exterior_wall_list.append(wall)

    # Create floor for each story level
    for ii in range(number_story):
        ll = allLevels[ii]
        floor_geometry = slab_geometry_by_level(LENGTH, WIDTH, ll, 0.0)
        floor = doc.Create.NewFloor(floor_geometry, default_floor_type, ll, True)
        floor_list.append(floor)

    # Create corridor lines

    MIN_ROOM_WIDTH = convert_meter_to_unit(4.)

    y_main_corridor = 0.5*WIDTH
    x_main_corridor_start = CORR_WIDTH
    x_main_corridor_end = LENGTH-CORR_WIDTH
    
    x_cross_start = x_main_corridor_start + 2*CORR_WIDTH
    x_cross_end = x_main_corridor_end - 2*CORR_WIDTH

    fractions_crossings = [1./(NUM_CROSSINGS-1)*i for i in range(NUM_CROSSINGS)] if NUM_CROSSINGS > 1 else [0.5]
    x_pos_crossings = [x_cross_start + fr * (x_cross_end - x_cross_start) for fr in fractions_crossings]

    main_lines_left = []
    main_lines_right = []
    middle_lines_left = []
    middle_lines_right = []

    for idx, x_pos_cross in enumerate(x_pos_crossings):
        if idx == 0:
            main_lines_left.append(
                [                
                    XYZ(0, y_main_corridor+CORR_WIDTH, ceiling),
                    XYZ(x_main_corridor_start, y_main_corridor+CORR_WIDTH, ceiling),
                    XYZ(x_main_corridor_start, y_main_corridor+CORR_WIDTH/2., ceiling),
                    XYZ(x_pos_cross-SIDE_HALLWAY_WIDTH/2., y_main_corridor+CORR_WIDTH/2., ceiling),
                    XYZ(x_pos_cross-SIDE_HALLWAY_WIDTH/2., WIDTH, ceiling)
                ]
            )
            main_lines_right.append(
                [
                    XYZ(0, y_main_corridor-CORR_WIDTH, ceiling),
                    XYZ(x_main_corridor_start, y_main_corridor-CORR_WIDTH, ceiling),
                    XYZ(x_main_corridor_start, y_main_corridor-CORR_WIDTH/2., ceiling),
                    XYZ(x_pos_cross-SIDE_HALLWAY_WIDTH/2., y_main_corridor-CORR_WIDTH/2., ceiling),
                    XYZ(x_pos_cross-SIDE_HALLWAY_WIDTH/2., 0, ceiling)
                ]
            )               
            room_dict.update({
                'CROWDIT_FIXED_0': [
                        (0.5, convert_to_meter(y_main_corridor-CORR_WIDTH)+0.5),
                        (convert_to_meter(x_main_corridor_start)-0.5, convert_to_meter(y_main_corridor+CORR_WIDTH)-0.5)
                    ]
                }
            )

        if idx == len(x_pos_crossings)-1:
            main_lines_left.append( 
                [
                    XYZ(LENGTH, y_main_corridor+CORR_WIDTH, ceiling),
                    XYZ(x_main_corridor_end, y_main_corridor+CORR_WIDTH, ceiling),
                    XYZ(x_main_corridor_end, y_main_corridor+CORR_WIDTH/2., ceiling),
                    XYZ(x_pos_cross+SIDE_HALLWAY_WIDTH/2., y_main_corridor+CORR_WIDTH/2., ceiling),
                    XYZ(x_pos_cross+SIDE_HALLWAY_WIDTH/2., WIDTH, ceiling),
                ]
            )
            main_lines_right.append(
                [
                    XYZ(LENGTH, y_main_corridor-CORR_WIDTH, ceiling),
                    XYZ(x_main_corridor_end, y_main_corridor-CORR_WIDTH, ceiling),
                    XYZ(x_main_corridor_end, y_main_corridor-CORR_WIDTH/2., ceiling),
                    XYZ(x_pos_cross+SIDE_HALLWAY_WIDTH/2., y_main_corridor-CORR_WIDTH/2., ceiling),
                    XYZ(x_pos_cross+SIDE_HALLWAY_WIDTH/2., 0, ceiling),
                ]
            )
            room_dict.update({
                'CROWDIT_FIXED_1': [
                        (convert_to_meter(x_main_corridor_end)+0.5, convert_to_meter(y_main_corridor+CORR_WIDTH)-0.5),
                        (convert_to_meter(LENGTH)-0.5, convert_to_meter(y_main_corridor-CORR_WIDTH)+0.5)
                    ]
                }
            )
        if idx < len(x_pos_crossings)-1:
            # Check if room width in (x direction) is still big enough
            assert (x_pos_crossings[idx+1]-x_pos_cross-SIDE_HALLWAY_WIDTH) >= MIN_ROOM_WIDTH, 'Minimum room width (in x direction) not maintained!'
            middle_lines_left.append(
                [
                    XYZ(x_pos_cross+SIDE_HALLWAY_WIDTH/2., WIDTH, ceiling),
                    XYZ(x_pos_cross+SIDE_HALLWAY_WIDTH/2., y_main_corridor+CORR_WIDTH/2., ceiling),
                    XYZ(x_pos_crossings[idx+1]-SIDE_HALLWAY_WIDTH/2., y_main_corridor+CORR_WIDTH/2., ceiling),
                    XYZ(x_pos_crossings[idx+1]-SIDE_HALLWAY_WIDTH/2., WIDTH, ceiling),
                ]
            )
            middle_lines_right.append(
                [
                    XYZ(x_pos_cross+SIDE_HALLWAY_WIDTH/2., 0, ceiling),
                    XYZ(x_pos_cross+SIDE_HALLWAY_WIDTH/2., y_main_corridor-CORR_WIDTH/2., ceiling),
                    XYZ(x_pos_crossings[idx+1]-SIDE_HALLWAY_WIDTH/2., y_main_corridor-CORR_WIDTH/2., ceiling),
                    XYZ(x_pos_crossings[idx+1]-SIDE_HALLWAY_WIDTH/2., 0, ceiling),
                ]
            )
        
        room_dict.update({
            'CROWDIT_FIXED_'+str(2+2*idx): [
                    (convert_to_meter(x_pos_cross-SIDE_HALLWAY_WIDTH/2.)+0.25, 0.25),
                    (convert_to_meter(x_pos_cross+SIDE_HALLWAY_WIDTH/2.)-0.25, 4)
                ]
            }
        )
        room_dict.update({
            'CROWDIT_FIXED_'+str(3+2*idx): [
                    (convert_to_meter(x_pos_cross-SIDE_HALLWAY_WIDTH/2.)+0.25, convert_to_meter(WIDTH)-0.25),
                    (convert_to_meter(x_pos_cross+SIDE_HALLWAY_WIDTH/2.)-0.25, convert_to_meter(WIDTH)-4)
                ]
            }
        )

    for idx, line in enumerate(main_lines_left+main_lines_right+middle_lines_left+middle_lines_right):
        idx_inc = 1
        if idx >= len(main_lines_left+main_lines_right):
            idx_inc = 0
        wall_lines = [Autodesk.Revit.DB.Line.CreateBound(line[id_l], line[id_l+1]) for id_l in range(len(line)-1)]
        # for idy, val in enumerate(line):
        #     print "y_val "+str(idy)+" in line "+str(idx)+": "+str(convert_to_meter(val[1]))

        walls = [Wall.Create(doc, wall_l, default_interior_wall_type.Id, allLevels[0].Id, allLevels[1].Elevation - allLevels[0].Elevation, 0, False, True) for wall_l in wall_lines]

        x_opening = (line[2+idx_inc][0] + line[1+idx_inc][0])/2.
        y_opening = line[2][1]
        z_opening = z_level

        start_point = XYZ(x_opening-DOOR_WIDTH_H, y_opening-DOOR_THICKNESS_H, z_opening)
        end_point = XYZ(x_opening+DOOR_WIDTH_H, y_opening+DOOR_THICKNESS_H, z_opening+DOOR_HEIGHT)
        opening = doc.Create.NewOpening(walls[1+idx_inc], start_point, end_point)

        room_y_min, room_y_max = min(line[0+2*idx_inc][1], line[1+3*idx_inc][1]), max(line[0+2*idx_inc][1], line[1+3*idx_inc][1])
        room_x_min, room_x_max = min(line[0+idx_inc][0], line[2+idx_inc][0]), max(line[0+idx_inc][0], line[2+idx_inc][0])

        room_dict.update({
            'CROWDIT_VAR_'+str(idx): [
                    (convert_to_meter(room_x_min)+0.5, convert_to_meter(room_y_min)+0.5),
                    (convert_to_meter(room_x_max)-0.5, convert_to_meter(room_y_max)-0.5)
                ]
            }
        )

#--------------------------------------------------------------
#------------------ OK NOW END THE CODE -----------------------
#--------------------------------------------------------------

TransactionManager.Instance.TransactionTaskDone()

###############################################################
# Prepare the output 
###############################################################
OUT = room_dict
# ----------------------------------------
save_to_txt = Python(IN[0]=create_corridor_crossings, IN[1]=create_folder)  # IronPython2
# ---------- save_to_txt.python (29 lines) ----------
# Phython-Standard- und DesignScript-Bibliotheken laden
import sys
import os
import clr
clr.AddReference('ProtoGeometry')
from Autodesk.DesignScript.Geometry import *

# Die Eingaben für diesen Block werden in Form einer Liste in den IN-Variablen gespeichert.
dataEnteringNode = IN
room_dict = IN[0]
txt_filepath = IN[1][0]

# Code unterhalb dieser Linie platzieren
if bool(room_dict) and txt_filepath:
	stdout_original = sys.stdout
	stdout_file = open(txt_filepath, 'w')
	sys.stdout = stdout_file
	
	for key in room_dict:
	    print key
	    for coord in room_dict[key]:
	        print "COORD_"+str(coord[0])+","+str(coord[1])
	    print ""
	
	sys.stdout = stdout_original
	stdout_file.close()

# Weisen Sie Ihre Ausgabe der OUT-Variablen zu.
OUT = [room_dict, txt_filepath]
# ----------------------------------------
watch_4 = Watch(save_to_txt)
watch_5 = Watch(create_folder)
watch_6 = Watch(create_corridor_crossings)
watch_7 = Watch(parameter_processing)
