# Dynamo graph 20220704_TRAIN_script_with_export_switch_ADVANCED.dyn (Dynamo 2.10.1.3976)

# group: Input parameters
SITE_X = DoubleSlider(65, range=20..100 step 5)  # graph input
SITE_Y = DoubleSlider(25, range=10..50 step 5)  # graph input
NUM_ESCALATORS_X = DoubleSlider(4, range=1..5 step 1)  # graph input
NUM_ESCALATORS_Y = DoubleSlider(2, range=1..2 step 1)  # graph input
apart_1_together_2 = IntegerSlider(2, range=1..2 step 1)  # graph input

parameter_processing = Python(IN[0]=SITE_X, IN[1]=SITE_Y, IN[2]=NUM_ESCALATORS_X, IN[3]=NUM_ESCALATORS_Y, IN[4]=apart_1_together_2)  # IronPython2; unwired: IN[5]
# ---------- parameter_processing.python (27 lines) ----------
# Phython-Standard- und DesignScript-Bibliotheken laden
import sys
import os
import clr
clr.AddReference('ProtoGeometry')
from Autodesk.DesignScript.Geometry import *

# Die Eingaben für diesen Block werden in Form einer Liste in den IN-Variablen gespeichert.
dataEnteringNode = IN

# Code unterhalb dieser Linie platzieren
site_x = int(IN[0])                                # the overall length of the site
site_y = int(IN[1])                                # the overall widthness of the site
NUM_ESCALATORS_X = int(IN[2]) # convert_meter_to_unit(3)
NUM_ESCALATORS_Y = int(IN[3])
LAYOUT_OPTION = int(IN[4]) # 1 = 'apart', 2 = 'together'

assert LAYOUT_OPTION in [1,2]
LAYOUT_OPTION = 'apart' if LAYOUT_OPTION == 1 else 'together'

if NUM_ESCALATORS_Y == 1:
    LAYOUT_OPTION = 'single'

txt_filename = \
    'floorplan_siteX_'+str(int(site_x))+'_siteY_'+str(int(site_y))+'_numEscX_'+str(NUM_ESCALATORS_X)+'_numEscY_'+str(NUM_ESCALATORS_Y)+'_SET_'+LAYOUT_OPTION+'.txt'
# Weisen Sie Ihre Ausgabe der OUT-Variablen zu.
OUT = txt_filename, [site_x, site_y, NUM_ESCALATORS_X, NUM_ESCALATORS_Y, LAYOUT_OPTION]
# ----------------------------------------
true_create_building_false = BoolSelector(true)  # "True== Create Building // False==Export Floorplan"; graph input; graph output
directory_path = Directory("C:\Users\ga78jem\Documents\Revit\Exports_ADVANCED")
string = StringInput("train_station")
create_folder_structure = BoolSelector(false)  # graph input
create_folder = Python(IN[0]=parameter_processing, IN[1]=true_create_building_false, IN[2]=directory_path, IN[3]=string, IN[4]=create_folder_structure)  # IronPython2; graph output
# ---------- create_folder.python (59 lines) ----------
# Phython-Standard- und DesignScript-Bibliotheken laden
import sys
import clr
clr.AddReference('ProtoGeometry')
from Autodesk.DesignScript.Geometry import *
import os
import shutil

clr.AddReference("RevitServices")
import RevitServices
from RevitServices.Persistence import DocumentManager 
doc = DocumentManager.Instance.CurrentDBDocument

# Die Eingaben für diesen Block werden in Form einer Liste in den IN-Variablen gespeichert.
dataEnteringNode = IN

# Code unterhalb dieser Linie platzieren

txt_filename = IN[0][0]
do_create = IN[1]
store_dir = IN[2]
layout_name = str(IN[3])
create_folder_structure = IN[4]

new_folder_name = None
txt_filepath = None

if create_folder_structure:

	dataset_folder_name = os.path.join(store_dir, layout_name)
	if not os.path.isdir(dataset_folder_name): os.mkdir(dataset_folder_name)
	
	new_folder_name = txt_filename.replace('.txt', '')
	# only check for duplicate settings when creating a new subfolder corresponding to the settings
	prefix = None
	if do_create:
		if len(os.listdir(dataset_folder_name)) > 0:
			for dirname in os.listdir(dataset_folder_name):
				assert new_folder_name != dirname.split('__')[-1], 'Duplicate settings!'
		prefix = str(len(os.listdir(dataset_folder_name)))+'__'
	
	elif not do_create:
		for dirname in os.listdir(dataset_folder_name):
			if new_folder_name == dirname.split('__')[-1]:
				prefix = dirname.split('__')[0] + '__'
	
	assert prefix, 'folder prefix is empty or doesnt exist, probably because a folder does not exist'
	new_folder_name = prefix+new_folder_name
	new_folder_name = os.path.join(dataset_folder_name, new_folder_name)
	
	# dont create the folder when exporting (it should already be there from the previous step...
	if do_create:
		os.mkdir(new_folder_name)
	#shutil.move(txt_filename, new_folder_name)
	txt_filepath = os.path.join(new_folder_name, txt_filename)

#doc.Regenerate()
# Weisen Sie Ihre Ausgabe der OUT-Variablen zu.
OUT = txt_filepath, do_create
# ----------------------------------------

# group: Floorplan View
element_types = ElementTypes("ViewPlan")
all_elements_of_type = ElementsOfType(element_type=element_types)
watch = Watch(all_elements_of_type)
code_block = CodeBlock(IN=watch) { OUT=IN[0]; }
id = Element.Id(element=code_block)

export2dxf_py = Python(IN[0]=create_folder, IN[1]=id)  # IronPython2
# ---------- export2dxf_py.python (59 lines) ----------
# Phython-Standard- und DesignScript-Bibliotheken laden
import sys
import os
import clr
clr.AddReference('ProtoGeometry')
from Autodesk.DesignScript.Geometry import *

clr.AddReference("RevitNodes")
import Revit

clr.ImportExtensions(Revit.Elements)
clr.ImportExtensions(Revit.GeometryConversion)

clr.AddReference("RevitServices")
import RevitServices
from RevitServices.Persistence import DocumentManager 
from RevitServices.Transactions import TransactionManager 

# Import RevitAPI
clr.AddReference("RevitAPI")
import Autodesk
from Autodesk.Revit.DB import *

clr.AddReference('System')
#from System.Collections.Generic import *
from System.Collections.Generic import List

# Die Eingaben für diesen Block werden in Form einer Liste in den IN-Variablen gespeichert.
dataEnteringNode = IN

# Code unterhalb dieser Linie platzieren
###############################################################
# Current doc/app/ui
###############################################################
doc = DocumentManager.Instance.CurrentDBDocument

txt_filepath = IN[0][0]
do_create = IN[0][1]
viewId = IN[1]

def ExportDxf(name, id, folder, filename):
	options = DXFExportOptions()
	options.TargetUnit = ExportUnit.Meter
	views = List[ElementId]()
	views.Add(ElementId(id))
	result = doc.Export(folder, name, views, options)
	return result

fullpath = None
if not do_create and txt_filepath: 
	folderPath = '\\'.join(txt_filepath.split('\\')[:-1])
	filename = txt_filepath.split('\\')[-1].replace('.txt', '.dxf')
	
	assert not os.path.isfile(os.path.join(folderPath, filename)), '.dxf already exists!'
	ExportDxf(filename, viewId, folderPath, filename)
	fullpath = txt_filepath.replace('.txt', '.dxf')

#Assign your output to the OUT variable
OUT = fullpath
# ----------------------------------------
watch_2 = Watch(export2dxf_py)
export2pdf_py = Python(IN[0]=create_folder, IN[1]=id)  # IronPython2
# ---------- export2pdf_py.python (62 lines) ----------
# Phython-Standard- und DesignScript-Bibliotheken laden
import sys
import os
import clr
clr.AddReference('ProtoGeometry')
from Autodesk.DesignScript.Geometry import *

clr.AddReference("RevitNodes")
import Revit

clr.ImportExtensions(Revit.Elements)
clr.ImportExtensions(Revit.GeometryConversion)

clr.AddReference("RevitServices")
import RevitServices
from RevitServices.Persistence import DocumentManager 
from RevitServices.Transactions import TransactionManager 

# Import RevitAPI
clr.AddReference("RevitAPI")
import Autodesk
from Autodesk.Revit.DB import *

clr.AddReference('System')
#from System.Collections.Generic import *
from System.Collections.Generic import List

# Die Eingaben für diesen Block werden in Form einer Liste in den IN-Variablen gespeichert.
dataEnteringNode = IN

# Code unterhalb dieser Linie platzieren
###############################################################
# Current doc/app/ui
###############################################################
doc = DocumentManager.Instance.CurrentDBDocument
txt_filepath = IN[0][0]
do_create = IN[0][1]
viewId = IN[1]
	
def ExportPdf(id, folder, filename):
	options = PDFExportOptions()
	options.FileName = filename
	#options.TargetUnit = ExportUnit.Meter
	views = List[ElementId]()
	views.Add(ElementId(id))
	result = doc.Export(folder, views, options)
	return result

full_path = None
if not do_create and txt_filepath:
	folderPath = '\\'.join(txt_filepath.split('\\')[:-1])
	filename = txt_filepath.split('\\')[-1].replace('.txt', '')
	#filename = folderPath.split('__')[-1].split('\\')[-1]
	#filename = txt_folderpath.replace('.txt', '')
	
	assert not os.path.isfile(txt_filepath.replace('.txt', '.pdf')), '.dxf already exists!'
	
	ExportPdf(viewId, folderPath, filename)
	full_path = txt_filepath.replace('.txt', '.pdf')

#Assign your output to the OUT variable
OUT = full_path
# ----------------------------------------
watch_3 = Watch(export2pdf_py)

# group: Wall & Floor Types
default_exterior_wall_types = WallTypes("Generic - 300mm")
default_floor_types = FloorTypes("Generic 150mm - Filled")
default_interior_wall_types = WallTypes("Generic - 200mm")

create_train_station = Python(IN[0]=default_exterior_wall_types, IN[1]=default_floor_types, IN[2]=default_interior_wall_types, IN[3]=parameter_processing, IN[4]=true_create_building_false)  # IronPython2
# ---------- create_train_station.python (508 lines) ----------
###############################################################
# Load the Libraries
###############################################################
import os
import clr
import sys
import math
import System

from System import Array
from System.Collections.Generic import *

clr.AddReference("RevitNodes")
import Revit

clr.ImportExtensions(Revit.Elements)
clr.ImportExtensions(Revit.GeometryConversion)

clr.AddReference("RevitServices")
import RevitServices
from RevitServices.Persistence import DocumentManager 
from RevitServices.Transactions import TransactionManager 

clr.AddReference("RevitAPI")
clr.AddReference("RevitAPIUI")

clr.AddReference('ProtoGeometry')
import Autodesk 
from Autodesk.DesignScript.Geometry import *
from Autodesk.Revit.DB import *
#from Autodesk.Revit.UI import *
from Autodesk.Revit.DB import StairsEditScope
from Autodesk.Revit.DB import Parameter
from Autodesk.Revit.DB.Architecture import StairsRun
from Autodesk.Revit.DB.Architecture import *
from Autodesk.Revit.DB import IFailuresPreprocessor

###############################################################
# Customize functions 
###############################################################
"""
Converts default unit in Dynamo into meter...
"""
def convert_meter_to_unit(pre_value):
    tempo_list = []
    tempo_value = 0
    if isinstance(pre_value, list):
        len_list = len(pre_value)
        for ii in range(len_list):
            tempo_list.append (float(UnitUtils.ConvertToInternalUnits(pre_value[ii], UnitTypeId.Meters)))
        pre_value = tempo_list
    else:
        tempo_value = float(UnitUtils.ConvertToInternalUnits(pre_value, UnitTypeId.Meters))
        pre_value = tempo_value
    return pre_value


def convert_to_meter(internal_value):
	if isinstance(internal_value, list):
		return [UnitUtils.ConvertFromInternalUnits(value, UnitTypeId.Meters) for value in internal_value]
	return float(UnitUtils.ConvertFromInternalUnits(internal_value, UnitTypeId.Meters))

"""
Provide perimeter lines from three dimensions...
"""
def find_perimeter_lines(x,y,z):
    line_list = []
    xx = x
    yy = y
    zz = z 
    # print "find_perimeter_lines x: " + str(x)
    # print "find_perimeter_lines y: " + str(y)
    # print "find_perimeter_lines z: " + str(z)
	
    line_1 = Autodesk.Revit.DB.Line.CreateBound(XYZ(0,0,zz),    XYZ(xx,0,zz))
    line_2 = Autodesk.Revit.DB.Line.CreateBound(XYZ(xx,0,zz),   XYZ(xx,yy,zz))
    line_3 = Autodesk.Revit.DB.Line.CreateBound(XYZ(xx,yy,zz),  XYZ(0,yy,zz))
    line_4 = Autodesk.Revit.DB.Line.CreateBound(XYZ(0,yy,zz),   XYZ(0,0,zz))

    line_list.append(line_1)
    line_list.append(line_2)
    line_list.append(line_3)
    line_list.append(line_4)
    
    return line_list

"""
Provide the geometry of slab by level...
"""
def slab_geometry_by_level(x,y,level,delta_z):
    zz = level.Elevation + delta_z
    xx = x
    yy = y 
    line_1 = Autodesk.Revit.DB.Line.CreateBound(XYZ(0,0,zz),    XYZ(xx,0,zz))
    line_2 = Autodesk.Revit.DB.Line.CreateBound(XYZ(xx,0,zz),   XYZ(xx,yy,zz))
    line_3 = Autodesk.Revit.DB.Line.CreateBound(XYZ(xx,yy,zz),  XYZ(0,yy,zz))
    line_4 = Autodesk.Revit.DB.Line.CreateBound(XYZ(0,yy,zz),   XYZ(0,0,zz))
    
    slab_geometry = CurveArray()
    slab_geometry.Append(line_1)
    slab_geometry.Append(line_2)
    slab_geometry.Append(line_3)
    slab_geometry.Append(line_4)
    return slab_geometry

###############################################################
# Current doc/app/ui
###############################################################
doc = DocumentManager.Instance.CurrentDBDocument
# uiapp = DocumentManager.Instance.CurrentUIApplication 
# app = uiapp.Application
# uidoc = uiapp.ActiveUIDocument

###############################################################
# Prepare the input
###############################################################
default_exterior_wall_type = UnwrapElement(IN[0])                   # Default exterior wall type
default_floor_type = UnwrapElement(IN[1])                           # Default Floor type
default_interior_wall_type = UnwrapElement(IN[2])				# Default interior wall type
### INPUT PARAMETERS ###
parameter_list = IN[3][1]
site_x = parameter_list[0]                                # the overall length of the site
site_y = parameter_list[1]                                # the overall widthness of the site
NUM_ESCALATORS_X = parameter_list[2] # convert_meter_to_unit(3)
NUM_ESCALATORS_Y = parameter_list[3]
LAYOUT_OPTION = parameter_list[4] # 1 = 'apart', 2 = 'together'

create_mode = IN[4]

number_story = 1                                          # the total amount of the stories;
story_z = [0]
site_z = 4                                              # the overall height of the site
ref_level_z = 0                                         # the z-position of the reference level (default level = level 0, created in the prepared .rvt)
###############################################################
# Transaction in Revit
###############################################################
TransactionManager.Instance.EnsureInTransaction(doc)
###############################################################
# Define the output
###############################################################

# Create room dict
room_dict = {}

if create_mode:
    geo_site = []                                                       # archive all the input data
    ref_level = []                                                      # the reference level
    bbox_site = []                                                      # bounding box of the site

    # sys.path.append('C:\Users\ga78jem\Miniconda3\envs\trajectron++\Lib\site-packages')

    ###############################################################
    # Convert the Units | b = UnitUtils.ConvertToInternalUnits(a, UnitTypeId.Meters)  b = a*3 | c = UnitUtils.ConvertFromInternalUnits(a, UnitTypeId.Meters)  c = a*3
    ###############################################################

    # print "site x before conversion:" + str(site_x)
    site_x = convert_meter_to_unit(site_x)
    site_y = convert_meter_to_unit(site_y)
    site_z = convert_meter_to_unit(site_z)
    ref_level_z = convert_meter_to_unit(ref_level_z)
    # print "site x after conversion:" + str(site_x)

    ###############################################################
    # Delete all levels apart from the reference level (when there are multiple levels)
    ###############################################################
    # Collect all levels
    levelArray = (FilteredElementCollector(doc)
        .OfCategory(BuiltInCategory.OST_Levels)
        .WhereElementIsNotElementType()
        .ToElements())

    def clear_model(bool_value):
        if bool_value:
            del_grid = FilteredElementCollector(doc).OfCategory(BuiltInCategory.OST_Grids).WhereElementIsNotElementType().ToElements()
            del_door = FilteredElementCollector(doc).OfCategory(BuiltInCategory.OST_Doors).WhereElementIsNotElementType().ToElements()
            del_floor = FilteredElementCollector(doc).OfCategory(BuiltInCategory.OST_Floors).WhereElementIsNotElementType().ToElements()
            del_wall = FilteredElementCollector(doc).OfCategory(BuiltInCategory.OST_Walls).WhereElementIsNotElementType().ToElements()
            del_roof = FilteredElementCollector(doc).OfCategory(BuiltInCategory.OST_Roofs).WhereElementIsNotElementType().ToElements()
            del_all = [del_grid, del_door, del_floor, del_wall, del_roof]
            for element_type in del_all:
                for element in element_type:
                    doc.Delete(element.Id)

    clear_model(True)

    # Check the number of the existing levels, if multiple, delete and save only one
    if levelArray.Count > 1:
        #print "levelArray.Count > 1, from 01_Site"
        for levelElement in levelArray:
            if levelElement.Elevation != ref_level_z:
                doc.Delete(levelElement.Id)
    ref_level = levelArray[0]
    ref_level.Name = "Story Level 0"

    # Check the if the saved one is the reference level, correct it if not
    if ref_level.Elevation != ref_level_z:
        ref_level_new = Autodesk.Revit.DB.Level.Create(doc, ref_level_z)
        doc.Delete(ref_level.Id)
        ref_level = ref_level_new
        ref_level.Name = "Story Level 0"

    #--------------------------------------------------------------
    #------------------ OK NOW YOU CAN CODE -----------------------
    #--------------------------------------------------------------

    # Create Bounding Box
    bb = BoundingBoxXYZ()
    bb.Min = XYZ(0, 0, 0)
    bb.Max = XYZ(0, 0, site_z)
    bbox_site.append(bb.ToProtoType())                  # the bounding box of the entire site
    # Close and save the recording file
    # geo_site.append(site_x)
    # geo_site.append(site_y)
    # geo_site.append(site_z)

    ###############################################################
    # END OF SCRIPT 1
    # START OF SCRIPT 2
    ###############################################################

    archive_data = []                                                   # archive all the input data
    bbox_story = []
    exterior_wall_list = []
    floor_list = []
    roof_list = []
    entrance_door_list = []

    ###############################################################
    # Convert the Units | b = UnitUtils.ConvertToInternalUnits(a, UnitTypeId.Meters)  b = a*3 | c = UnitUtils.ConvertFromInternalUnits(a, UnitTypeId.Meters)  c = a*3
    ###############################################################
    story_z = convert_meter_to_unit(story_z)

    # Collect all levels
    levelArray = (FilteredElementCollector(doc)
        .OfCategory(BuiltInCategory.OST_Levels)
        .WhereElementIsNotElementType()
        .ToElements())

    # Check the number of the existing levels, if multiple, delete and save only one
    if levelArray.Count > 1:
        #print "levelArray.Count > 1, from 02_Story"
        for levelElement in levelArray:
            if levelElement.Elevation != ref_level.Elevation:
                doc.Delete(levelElement.Id)
    ref_level = levelArray[0]
    ref_level.Name = "Story Level 0"

    # Check the if the saved one is the reference level, correct it if not
    if ref_level.Elevation != 0:
        ref_level_new = Autodesk.Revit.DB.Level.Create(doc, 0)
        doc.Delete(ref_level.Id)
        ref_level = ref_level_new
        ref_level.Name = "Story Level 0"

    ###############################################################
    # Check the consistence with the bouning box of the side 
    ###############################################################
    # Check the z-position of the highest story against the site box

    check_site_story = True if max(story_z) < site_z else False
    #print "The stories are consistent with the overal site:" + str(check_site_story)

    # Create new story levels
    for ii in range(number_story):
        if ref_level.Elevation == story_z[ii]:
            continue
        new_level = Autodesk.Revit.DB.Level.Create(doc, story_z[ii])
        new_level.Name = "Story Level " + str(ii)

    # Create the roof level
    roof_level = Autodesk.Revit.DB.Level.Create(doc, site_z)
    roof_level.Name = "Roof Level"

    # all levels
    allLevels = FilteredElementCollector(doc).OfClass(Level).ToElements()

    # Create Bounding Box for each story level
    for ii in range(number_story):
        level_bbox_end_z = story_z[ii+1] if ii < (number_story-1) else site_z
        #print "Story"+str(ii)
        #print str(level_bbox_end_z)
        bb = BoundingBoxXYZ()
        bb.Min = XYZ(0, 0, story_z[ii])
        bb.Max = XYZ(site_x, site_y, level_bbox_end_z)
        bbox_story.append(bb.ToProtoType())

    ##############################################################################################################################
    ##############################################################################################################################
    # Create floorplan complexity
    ##############################################################################################################################
    ##############################################################################################################################
    LENGTH = site_x
    WIDTH = site_y
    print 'x_length: ' + str(convert_to_meter(LENGTH))
    print 'y_width: ' + str(convert_to_meter(WIDTH))
    z_level = ref_level.Elevation
    # Create floor for each story level
    for ii in range(number_story):
        ll = allLevels[ii]
        floor_geometry = slab_geometry_by_level(LENGTH, WIDTH, ll, 0.0)
        floor = doc.Create.NewFloor(floor_geometry, default_floor_type, ll, True)
        floor_list.append(floor)

    # Create the exterior walls
    # perimeter_lines = find_perimeter_lines(LENGTH, WIDTH, z_level)
    # for ww in range(4):
    #     wall = Wall.Create(doc, perimeter_lines[ww], default_exterior_wall_type.Id, ref_level.Id, site_z, 0, False, True)
    #     exterior_wall_list.append(wall)

    # Create escalator-like rooms
    escalator_x_range = 2.*LENGTH/3.
    start_point_x = (LENGTH-escalator_x_range)/2.
    end_point_x = LENGTH - (LENGTH - escalator_x_range)/2.

    start_point_y = WIDTH/2. - convert_meter_to_unit(4)
    end_point_y = WIDTH/2. + convert_meter_to_unit(4)

    fractions_x = [1./(NUM_ESCALATORS_X-1)*i_x for i_x in range(NUM_ESCALATORS_X)] if NUM_ESCALATORS_X > 1 else [0.5]

    if LAYOUT_OPTION in ['single', 'together']:
        escalator_y_list = [(end_point_y + start_point_y)/2.]
    elif LAYOUT_OPTION == 'apart':
        fractions_y = [1./(NUM_ESCALATORS_Y-1)*i_y for i_y in range(NUM_ESCALATORS_Y)]
        escalator_y_list = [start_point_y + fr * (end_point_y - start_point_y) for fr in fractions_y]
    
    escalator_x_list = [start_point_x + fr * (end_point_x - start_point_x) for fr in fractions_x]

    for idx, escalator_x in enumerate(escalator_x_list):
        for idy, escalator_y in enumerate(escalator_y_list):
            x_or = escalator_x
            y_or = escalator_y
            x_diff = convert_meter_to_unit(1.5)
            y_diff = convert_meter_to_unit(0.75)
            if LAYOUT_OPTION == 'together':
                P1 = XYZ(x_or+x_diff, y_or+2*y_diff, z_level)
                P2 = XYZ(x_or-x_diff, y_or+2*y_diff, z_level)
                P3 = XYZ(x_or-x_diff, y_or, z_level)
                P4 = XYZ(x_or+x_diff, y_or, z_level)
                P5 = XYZ(x_or-x_diff, y_or-2*y_diff, z_level)
                P6 = XYZ(x_or+x_diff, y_or-2*y_diff, z_level)

                if idx < len(escalator_x_list)/2.:
                    line_1 = Autodesk.Revit.DB.Line.CreateBound(P1, P2)
                    line_2 = Autodesk.Revit.DB.Line.CreateBound(P2, P3)
                    line_3 = Autodesk.Revit.DB.Line.CreateBound(P3, P4)
                    line_4 = Autodesk.Revit.DB.Line.CreateBound(P3, P5)
                    line_5 = Autodesk.Revit.DB.Line.CreateBound(P5, P6)
                else:
                    line_1 = Autodesk.Revit.DB.Line.CreateBound(P2, P1)
                    line_2 = Autodesk.Revit.DB.Line.CreateBound(P1, P4)
                    line_3 = Autodesk.Revit.DB.Line.CreateBound(P4, P3)
                    line_4 = Autodesk.Revit.DB.Line.CreateBound(P4, P6)
                    line_5 = Autodesk.Revit.DB.Line.CreateBound(P6, P5)

                lines = [line_1, line_2, line_3, line_4, line_5]

                room_dict.update({
                    'CROWDIT_FIXED_'+str(2*idx): [
                            (convert_to_meter(x_or)-1.3, convert_to_meter(y_or)-1.25),
                            (convert_to_meter(x_or)+1.3, convert_to_meter(y_or)-0.25)
                        ]
                    }
                )
                room_dict.update({
                    'CROWDIT_FIXED_'+str(2*idx+1): [
                            (convert_to_meter(x_or)-1.3, convert_to_meter(y_or)+0.25),
                            (convert_to_meter(x_or)+1.3, convert_to_meter(y_or)+1.25)
                        ]
                    }
                )

            else:
                P1, P2, P3, P4 = XYZ(x_or+x_diff, y_or+y_diff, z_level), XYZ(x_or-x_diff, y_or+y_diff, z_level), XYZ(x_or-x_diff, y_or-y_diff, z_level), XYZ(x_or+x_diff, y_or-y_diff, z_level)

                if idx < len(escalator_x_list)/2.:
                    line_1 = Autodesk.Revit.DB.Line.CreateBound(P1, P2)
                    line_2 = Autodesk.Revit.DB.Line.CreateBound(P2, P3)
                    line_3 = Autodesk.Revit.DB.Line.CreateBound(P3, P4)
                else:
                    line_1 = Autodesk.Revit.DB.Line.CreateBound(P2, P1)
                    line_2 = Autodesk.Revit.DB.Line.CreateBound(P1, P4)
                    line_3 = Autodesk.Revit.DB.Line.CreateBound(P4, P3)
                

                lines = [line_1, line_2, line_3]

                room_dict.update({
                    'CROWDIT_FIXED_'+str(len(escalator_y_list)*idx+idy): [
                            (convert_to_meter(x_or)-1.3, convert_to_meter(y_or)-0.5),
                            (convert_to_meter(x_or)+1.3, convert_to_meter(y_or)+0.5)
                        ]
                    }
                )
            
            walls = [Wall.Create(doc, line, ElementId(408), ref_level.Id, site_z, 0, False, True) for line in lines] # 408 is Id for a thin wall, find it via Block "Wall Types" -> Python script to output WallTypes.Id

    # Add structural elements (columns and benches)
    pilar_origin_list = [(escalator_x_list[i+1]+escalator_x_list[i])/2. for i in range(len(escalator_x_list) - 1)]
    #if len(pilar_origin_list) > 1:
    obs_counter = 0
    for idx, pilar_origin in enumerate(pilar_origin_list):
        # Adding column obstacles
        column_width = 1.0
        room_dict.update({
            'OBS_FIXED_'+str(obs_counter): [
                    (convert_to_meter(pilar_origin)-column_width, convert_to_meter(WIDTH/2.)-column_width),
                    (convert_to_meter(pilar_origin)+column_width, convert_to_meter(WIDTH/2.)+column_width)
                ]
            }
        )
        # wall_c = Wall.Create(doc, \
        #     Autodesk.Revit.DB.Line.CreateBound(XYZ(pilar_origin-convert_meter_to_unit(column_width), WIDTH/2., site_z), XYZ(pilar_origin+convert_meter_to_unit(column_width), WIDTH/2., site_z)), \
        #     ElementId(408), ref_level.Id, site_z, 0, False, True)
        obs_counter += 1
        
        # Adding bench obstacles
        # bench_length, bench_width = 2.0/2., 1.0/2.
        # bench_origin = (pilar_origin+escalator_x_list[idx+1])/2.
        # room_dict.update({
        #     'OBS_FIXED_'+str(obs_counter): [
        #             (convert_to_meter(bench_origin) - bench_length, convert_to_meter(WIDTH/2.) - bench_width),
        #             (convert_to_meter(bench_origin) + bench_length, convert_to_meter(WIDTH/2.) + bench_width)
        #         ]
        #     }
        # )
        # obs_counter += 1
        
        # wall_b = Wall.Create(doc, \
        #     Autodesk.Revit.DB.Line.CreateBound(XYZ(bench_origin-convert_meter_to_unit(bench_length), WIDTH/2., site_z), XYZ(bench_origin+convert_meter_to_unit(bench_length), WIDTH/2., site_z)), \
        #     ElementId(408), ref_level.Id, site_z, 0, False, True)



    # Create origin spaces
    MAX_CROWDIT_AREAS_PER_SIDE = 4
    src_range = 3.*LENGTH / 4. # 5.*LENGTH/6.
    start_point = (LENGTH-src_range)/2.
    end_point = LENGTH - (LENGTH - src_range)/2.

    track_areas_length = LENGTH/(MAX_CROWDIT_AREAS_PER_SIDE)-convert_meter_to_unit(0.2)

    var_set_left = 0
    var_set_right = 0

    # iterate over first tracks line
    for num_srcs_left in range(MAX_CROWDIT_AREAS_PER_SIDE+1):

        if num_srcs_left == 0:
            fractions_left = []
            room_dict.update({
                'CROWDIT_VARSET_LEFT_'+str(var_set_left)+'_0': []
                }
            )
        elif num_srcs_left == 1: 
            fractions_left = [0.5] 
        else:
            fractions_left = [1./(num_srcs_left-1)*i for i in range(num_srcs_left)]

        source_list_left = [start_point + fr * (end_point - start_point) for fr in fractions_left]
        for id_l, src_left in enumerate(source_list_left):
            
            room_dict.update({
                'CROWDIT_VARSET_LEFT_'+str(var_set_left)+'_'+str(id_l): [
                        (convert_to_meter(src_left) + convert_to_meter(track_areas_length/2.), 0.1),
                        (convert_to_meter(src_left) - convert_to_meter(track_areas_length/2.), 1.6)
                    ]
                }
            )
        var_set_left += 1
    
    # iterate over second tracks line
    for num_srcs_right in range(MAX_CROWDIT_AREAS_PER_SIDE+1):

        if num_srcs_right == 0:
            fractions_right = []
            room_dict.update({
                'CROWDIT_VARSET_RIGHT_'+str(var_set_right)+'_0': []
                }
            )
        elif num_srcs_right == 1:
            fractions_right = [0.5]
        else:
            fractions_right = [1./(num_srcs_right-1)*i for i in range(num_srcs_right)]

        source_list_right = [start_point + fr * (end_point - start_point) for fr in fractions_right]
        for id_r, src_right in enumerate(source_list_right):
            
            room_dict.update({
                'CROWDIT_VARSET_RIGHT_'+str(var_set_right)+'_'+str(id_r): [
                        (convert_to_meter(src_right) + convert_to_meter(track_areas_length/2.), convert_to_meter(WIDTH) - 0.1),
                        (convert_to_meter(src_right) - convert_to_meter(track_areas_length/2.), convert_to_meter(WIDTH) - 1.6)
                    ]
                }
            )

        var_set_right += 1


#--------------------------------------------------------------
#------------------ OK NOW END THE CODE -----------------------
#--------------------------------------------------------------

TransactionManager.Instance.TransactionTaskDone()

###############################################################
# Prepare the output 
###############################################################
OUT = room_dict
# ----------------------------------------
save_to_txt = Python(IN[0]=create_train_station, IN[1]=create_folder)  # IronPython2
# ---------- save_to_txt.python (33 lines) ----------
# Phython-Standard- und DesignScript-Bibliotheken laden
import sys
import os
import clr
clr.AddReference('ProtoGeometry')
from Autodesk.DesignScript.Geometry import *

# Die Eingaben für diesen Block werden in Form einer Liste in den IN-Variablen gespeichert.
dataEnteringNode = IN
room_dict = IN[0]
txt_filepath = IN[1][0]

# Code unterhalb dieser Linie platzieren
if bool(room_dict) and txt_filepath:
    stdout_original = sys.stdout
    stdout_file = open(txt_filepath, 'w')
    sys.stdout = stdout_file

    for key in room_dict:
        print key
        if len(room_dict[key]) > 0:
            for coord in room_dict[key]:
                print "COORD_"+str(coord[0])+","+str(coord[1])
        else:
            for i in range(2):
                print "COORD_EMPTY"
        print ""

    sys.stdout = stdout_original
    stdout_file.close()

# Weisen Sie Ihre Ausgabe der OUT-Variablen zu.
OUT = [room_dict, txt_filepath]
# ----------------------------------------
watch_4 = Watch(save_to_txt)
watch_5 = Watch(create_folder)
watch_6 = Watch(create_train_station)
